# Grasshopper definition 03 - Crosshatch.gh (Grasshopper 1.0.7)
# plug-ins: Human

number_slider = Slider(0.5, range=0..1)
number_slider_2 = Slider(19, range=0..100)
series = Series(Start=Slider(0, range=0..100), Step=number_slider, Count=number_slider_2)
number_slider_3 = Slider(0, range=0..100)
square = Square(Plane=PlaneXY(0, 0, 0), Size=number_slider, ExtentX=number_slider_2, ExtentY=Slider(15, range=0..100))  # -> Cells, Points
panel = Panel(series)
construct_point = ConstructPoint(XCoordinate=series, YCoordinate=number_slider_3, ZCoordinate=number_slider_3)
panel_2 = Panel(square.Points)
point = Point(square.Points)
polygon = Polygon(Plane=point, Radius=Slider(0.25, range=0..1), Segments=Slider(4, range=0..10), FilletRadius=0)  # -> Polygon, Length
degrees = Degrees(Radians=Slider(41, range=0..100))
rotate = Rotate(Geometry=polygon.Polygon, Angle=degrees, Plane=polygon.Polygon)  # -> Geometry, Transform
curve = Curve(rotate.Geometry)
degrees_2 = Degrees(Radians=Slider(45, range=0..100))
unit_x = UnitX(Factor=Slider(0.2, range=0..1))
move = Move(Geometry=curve, Motion=unit_x)  # -> Geometry, Transform
curve_2 = Curve(move.Geometry)
unit_y = UnitY(Factor=Slider(0.1, range=0..1))
move_2 = Move(Geometry=curve_2, Motion=unit_y)  # -> Geometry, Transform
curve_3 = Curve(move_2.Geometry)
createhatch = CreateHatch(Bake=False, Curves=curve_3, HatchPatternName="Hatch1", HatchScale=Slider(0.7, range=0..1), HatchRotation=degrees_2)  # -> HatchGeometry, HatchObjects
unit_y_2 = UnitY(Factor=Slider(0.1, range=0..1))
curve_4 = Curve(createhatch.HatchGeometry)
curve_5 = Curve(createhatch.HatchGeometry)
curve_6 = Curve(curve_4)
curve_7 = Curve(curve_4)
move_3 = Move(Geometry=curve_5, Motion=unit_y_2)  # -> Geometry, Transform
curve_8 = Curve(move_3.Geometry)
construct_point_2 = ConstructPoint(XCoordinate=Slider(5, range=0..10), YCoordinate=Slider(4, range=0..10), ZCoordinate=0)
number_slider_4 = Slider(22, range=0..100)
stretch = Stretch(Geometry=curve_7, Axis=Line((0, 0, 0), (10, 10, 0)), Length=Slider(0, range=0..1), Rigid=False)
xy_plane = XYPlane(Origin=construct_point_2)
number_slider_5 = Slider(0, range=0..100)
curve_9 = Curve(stretch)
rotate_2 = Rotate(Geometry=curve_8, Angle=Slider(0.7, range=0..1), Plane=xy_plane)  # -> Geometry, Transform
construct_point_3 = ConstructPoint(XCoordinate=number_slider_5, YCoordinate=number_slider_5, ZCoordinate=0)
curve_10 = Curve(rotate_2.Geometry)
xy_plane_2 = XYPlane(Origin=construct_point_3)
construct_point_4 = ConstructPoint(XCoordinate=Slider(0, range=0..100), YCoordinate=Slider(8, range=0..10), ZCoordinate=0)
construct_point_5 = ConstructPoint(XCoordinate=Slider(10, range=0..10), YCoordinate=Slider(0, range=0..100), ZCoordinate=0)
rectangle_2pt = Rectangle2Pt(Plane=xy_plane_2, PointA=construct_point_4, PointB=construct_point_5, Radius=0)  # -> Rectangle, Length
trim_with_region = TrimWithRegion(Curve=[curve_10, curve_4], Region=rectangle_2pt.Rectangle, Plane=xy_plane_2)  # -> Inside, Outside
curve_11 = Curve(trim_with_region.Inside)
