# Grasshopper definition 04 - CrossHatch 2.gh (Grasshopper 1.0.7)
# plug-ins: Human

number_slider = Slider(0.5, range=0..1)
number_slider_2 = Slider(19, range=0..100)
series = Series(Start=Slider(0, range=0..100), Step=number_slider, Count=number_slider_2)
number_slider_3 = Slider(0, range=0..100)
square = Square(Plane=PlaneXY(0, 0, 0), Size=number_slider, ExtentX=number_slider_2, ExtentY=Slider(15, range=0..100))  # -> Cells, Points
panel = Panel(series)
construct_point = ConstructPoint(XCoordinate=series, YCoordinate=number_slider_3, ZCoordinate=number_slider_3)
panel_2 = Panel(square.Points)
point = Point(square.Points)
polygon = Polygon(Plane=point, Radius=Slider(0.54, range=0..1), Segments=Slider(4, range=0..10), FilletRadius=0)  # -> Polygon, Length
degrees = Degrees(Radians=Slider(47, range=0..100))
rotate = Rotate(Geometry=polygon.Polygon, Angle=degrees, Plane=polygon.Polygon)  # -> Geometry, Transform

# ---- group: ATTRACTOR
point_2 = Point(Point(8.774788799, 6.223275724, 0))
point_3 = Point(Point(7.10750344, 1.923718486, 0))
point_4 = Point(Point(5.498083061, 4.053885926, 0))

# ----
curve = Curve(rotate.Geometry)

# ---- group: ATTRACTOR
curve_2 = Curve(rotate.Geometry)
closest_point = ClosestPoint(Point=point, Cloud=[point_4, point_2, point_3])  # -> ClosestPoint, CPIndex, Distance
number_slider_4 = Slider(0.1, range=0..0.1)
bounds = Bounds(Numbers=closest_point.Distance)
construct_domain = ConstructDomain(DomainStart=Slider(0.4, range=0..1), DomainEnd=Slider(1, range=0..1))
remap_numbers = RemapNumbers(Value=closest_point.Distance, Source=bounds, Target=construct_domain)  # -> Mapped, Clipped
scale = Scale(Geometry=curve_2, Center=point, Factor=remap_numbers.Clipped)  # -> Geometry, Transform

# ----
taper = Taper(Geometry=curve_2, Flat=False, Infinite=False, Rigid=False)
number_slider_5 = Slider(0.6, range=0..1)
taper_2 = Taper(Flat=False, Infinite=False, Rigid=False)
degrees_2 = Degrees(Radians=Slider(45, range=0..100))
unit_x = UnitX(Factor=Slider(0.2, range=0..1))
move = Move(Geometry=scale.Geometry, Motion=unit_x)  # -> Geometry, Transform
curve_3 = Curve(move.Geometry)
unit_y = UnitY(Factor=Slider(0.1, range=0..1))
move_2 = Move(Geometry=curve_3, Motion=unit_y)  # -> Geometry, Transform
curve_4 = Curve(move_2.Geometry)
createhatch = CreateHatch(Bake=False, Curves=curve_4, HatchPatternName="Hatch1", HatchScale=Slider(0.7, range=0..1), HatchRotation=degrees_2)  # -> HatchGeometry, HatchObjects
curve_5 = Curve(createhatch.HatchGeometry)
curve_6 = Curve(curve_5)
unit_y_2 = UnitY(Factor=Slider(0.1, range=0..1))
curve_7 = Curve()
move_3 = Move(Geometry=curve_6, Motion=unit_y_2)  # -> Geometry, Transform
curve_8 = Curve(move_3.Geometry)
construct_point_2 = ConstructPoint(XCoordinate=Slider(5, range=0..10), YCoordinate=Slider(4, range=0..10), ZCoordinate=0)
number_slider_6 = Slider(22, range=0..100)
xy_plane = XYPlane(Origin=construct_point_2)
number_slider_7 = Slider(0, range=0..100)
rotate_2 = Rotate(Geometry=curve_8, Angle=Slider(0.7, range=0..1), Plane=xy_plane)  # -> Geometry, Transform
construct_point_3 = ConstructPoint(XCoordinate=number_slider_7, YCoordinate=number_slider_7, ZCoordinate=0)
curve_9 = Curve(rotate_2.Geometry)
xy_plane_2 = XYPlane(Origin=construct_point_3)
construct_point_4 = ConstructPoint(XCoordinate=Slider(0, range=0..100), YCoordinate=Slider(8, range=0..10), ZCoordinate=0)
construct_point_5 = ConstructPoint(XCoordinate=Slider(10, range=0..10), YCoordinate=Slider(0, range=0..100), ZCoordinate=0)
rectangle_2pt = Rectangle2Pt(Plane=xy_plane_2, PointA=construct_point_4, PointB=construct_point_5, Radius=0)  # -> Rectangle, Length
trim_with_region = TrimWithRegion(Curve=[curve_9, curve_5], Region=rectangle_2pt.Rectangle, Plane=xy_plane_2)  # -> Inside, Outside
curve_10 = Curve(trim_with_region.Inside)
bend_deform = BendDeform(Geometry=curve_10)
