# Grasshopper definition 06 - Tunnel.gh (Grasshopper 1.0.7)

series = Series(Start=Slider(1, range=0..1), Step=Slider(0.5, range=0..1), Count=Slider(19, range=0..100))
number_slider = Slider(0, range=0..100)
construct_point = ConstructPoint(XCoordinate=series, YCoordinate=number_slider, ZCoordinate=number_slider)
panel = Panel(construct_point)
square = Square(Plane=construct_point, Size=1, ExtentX=construct_point, ExtentY=Slider(15, range=0..100))  # -> Cells, Points
panel_2 = Panel(square.Points)
point = Point(square.Points)
polygon = Polygon(Plane=PlaneXY(0, 0, 0), Radius=point, Segments=Slider(4, range=0..10), FilletRadius=0)  # -> Polygon, Length
degrees = Degrees(Radians=Slider(41, range=0..100))
rotate = Rotate(Geometry=polygon.Polygon, Angle=degrees, Plane=PlaneXY(0, 0, 0))  # -> Geometry, Transform
number_slider_2 = Slider(2, range=1..100)
merge = Merge(Data1=polygon.Polygon, Data2=rotate.Geometry)
curve = Curve(merge)
unit_x = UnitX(Factor=Slider(9, range=0..10))
move = Move(Geometry=curve, Motion=unit_x)  # -> Geometry, Transform
number_slider_3 = Slider(0.3, range=0.1..1)
scale = Scale(Geometry=move.Geometry, Center=Point(0, 0, 0), Factor=Slider(1.123, range=0..10))  # -> Geometry, Transform
unit_y = UnitY(Factor=Slider(4.027, range=0..10))
curve_2 = Curve(scale.Geometry)
move_2 = Move(Geometry=curve_2, Motion=unit_y)  # -> Geometry, Transform
curve_3 = Curve(move_2.Geometry)
curve_4 = Curve(<curve referenced from the Rhino model>)
trim_with_region = TrimWithRegion(Curve=curve_3, Region=curve_4)  # -> Inside, Outside
curve_5 = Curve(trim_with_region.Inside)
